# Grasshopper definition rhinoPaths_components.gh (Grasshopper 1.0.8)

rpcutout = RhinoPathsCutout()  # -> toolpath, passes
#   port boundary: Outer boundary curve
#   port tool_diam: Tool diameter, mm
#   port side: Offset side: outside/inside/on
#   port climb: True: climb, False: conventional
#   port start_z: Top of material, mm
#   port end_z: Cutting depth, mm (negative)
#   port pass_depth: Max step-down per pass, mm
#   port toolpath: 2D toolpath curves at cut side
#   port passes: 3D toolpath curves at each Z level
# ---------- rpcutout: Python ----------
import sys as _sys, os as _os
_SRC = _os.path.normpath(_os.path.expanduser("~/antigravity/scratch/opencam-rhino8/src"))
if _os.path.exists(_SRC) and _SRC not in _sys.path:
    _sys.path.insert(0, _SRC)

_RHINO_SITE = _os.path.expanduser("~/.rhinocode/py39-rh8/lib/python3.9/site-packages")
if _os.path.exists(_RHINO_SITE) and _RHINO_SITE not in _sys.path:
    _sys.path.insert(0, _RHINO_SITE)

import traceback
from rhinopaths.geometry import curve_to_polyline, polyline_to_curve
from rhinopaths.toolpaths import cutout, pass_depths, apply_z

# Defaults
if tool_diam is None: tool_diam = 6.0
if side is None: side = "outside"
if climb is None: climb = True
if start_z is None: start_z = 0.0
if end_z is None: end_z = -18.0
if pass_depth is None: pass_depth = 6.0

toolpath = []
passes = []

try:
    if boundary:
        tol = 0.01
        pts = curve_to_polyline(boundary, tol)
        
        path_2d = cutout(pts, tool_diam, side, climb)
        
        if path_2d:
            toolpath = [polyline_to_curve(path_2d)]
            
            # Apply Z passes
            depths = pass_depths(start_z, end_z, pass_depth)
            passes_3d = apply_z(path_2d, depths)
            passes = [polyline_to_curve(p) for p in passes_3d]

except Exception as e:
    print(f"Error computing cutout: {e}")
    print(traceback.format_exc())
# ---------- end rpcutout ----------
rppocket = RhinoPathsPocket()  # -> shells, passes; inputs islands: list
#   port boundary: Outer pocket boundary
#   port islands: Optional island curves (bosses to avoid)
#   port tool_diam: Tool diameter, mm
#   port stepover: Stepover fraction (0.0–1.0), default 0.5
#   port start_z: Top of material, mm
#   port end_z: Pocket depth, mm (negative)
#   port pass_depth: Max step-down per pass, mm
#   port shells: 2D toolpath shells
#   port passes: 3D toolpath curves at each Z level
# ---------- rppocket: Python ----------
import sys as _sys, os as _os
_SRC = _os.path.normpath(_os.path.expanduser("~/antigravity/scratch/opencam-rhino8/src"))
if _os.path.exists(_SRC) and _SRC not in _sys.path:
    _sys.path.insert(0, _SRC)

_RHINO_SITE = _os.path.expanduser("~/.rhinocode/py39-rh8/lib/python3.9/site-packages")
if _os.path.exists(_RHINO_SITE) and _RHINO_SITE not in _sys.path:
    _sys.path.insert(0, _RHINO_SITE)

import traceback
from rhinopaths.geometry import curve_to_polyline, polyline_to_curve
from rhinopaths.toolpaths import pocket, pass_depths, apply_z

if tool_diam is None: tool_diam = 6.0
if stepover is None: stepover = 0.5
if start_z is None: start_z = 0.0
if end_z is None: end_z = -12.0
if pass_depth is None: pass_depth = 6.0

shells = []
passes = []

try:
    if boundary:
        tol = 0.01
        boundary_pts = curve_to_polyline(boundary, tol)
        island_pts_list = [curve_to_polyline(c, tol) for c in (islands or [])]

        shells_2d = pocket(boundary_pts, island_pts_list, tool_diam, stepover)
        
        if shells_2d:
            shells = [polyline_to_curve(s) for s in shells_2d]
            
            depths = pass_depths(start_z, end_z, pass_depth)
            passes_3d = []
            for shell in shells_2d:
                passes_3d.extend(apply_z(shell, depths))
            passes = [polyline_to_curve(p) for p in passes_3d]

except Exception as e:
    print(f"Error computing pocket: {e}")
    print(traceback.format_exc())
# ---------- end rppocket ----------
rpdrill = RhinoPathsDrill()  # -> centres; inputs circles: list
#   port circles: Circles to drill
#   port start_z: Top of material, mm
#   port end_z: Drill depth, mm (negative)
#   port centres: Extracted drill centres
# ---------- rpdrill: Python ----------
import sys as _sys, os as _os
_SRC = _os.path.normpath(_os.path.expanduser("~/antigravity/scratch/opencam-rhino8/src"))
if _os.path.exists(_SRC) and _SRC not in _sys.path:
    _sys.path.insert(0, _SRC)

_RHINO_SITE = _os.path.expanduser("~/.rhinocode/py39-rh8/lib/python3.9/site-packages")
if _os.path.exists(_RHINO_SITE) and _RHINO_SITE not in _sys.path:
    _sys.path.insert(0, _RHINO_SITE)

import traceback
import Rhino.Geometry as rg
from rhinopaths.geometry import curve_to_polyline
from rhinopaths.toolpaths import drill

if start_z is None: start_z = 0.0
if end_z is None: end_z = -10.0

centres = []

try:
    if circles:
        tol = 0.01
        polys = [curve_to_polyline(c, tol) for c in circles]
        pts = drill(polys)
        
        for pt in pts:
            # Drop the centre to end_z so the postprocessor drills to that Z
            centres.append(rg.Point3d(pt[0], pt[1], end_z))

except Exception as e:
    print(f"Error extracting drill centres: {e}")
    print(traceback.format_exc())
# ---------- end rpdrill ----------
rpengrave = RhinoPathsEngrave()  # -> passes; inputs curves: list
#   port curves: Curves to engrave
#   port z_depth: Engraving depth, mm (negative)
#   port passes: Sorted and Z-aligned engraving curves
# ---------- rpengrave: Python ----------
import sys as _sys, os as _os
_SRC = _os.path.normpath(_os.path.expanduser("~/antigravity/scratch/opencam-rhino8/src"))
if _os.path.exists(_SRC) and _SRC not in _sys.path:
    _sys.path.insert(0, _SRC)

_RHINO_SITE = _os.path.expanduser("~/.rhinocode/py39-rh8/lib/python3.9/site-packages")
if _os.path.exists(_RHINO_SITE) and _RHINO_SITE not in _sys.path:
    _sys.path.insert(0, _RHINO_SITE)

import traceback
from rhinopaths.geometry import curve_to_polyline, polyline_to_curve
from rhinopaths.toolpaths import engrave

if z_depth is None: z_depth = -1.0

passes = []

try:
    if curves:
        tol = 0.01
        polys = [curve_to_polyline(c, tol) for c in curves]
        
        # apply z_depth locally before sort
        z_polys = []
        for poly in polys:
            z_polys.append([(p[0], p[1], z_depth) for p in poly])

        sorted_polys = engrave(z_polys)
        passes = [polyline_to_curve(p) for p in sorted_polys]

except Exception as e:
    print(f"Error sorting engrave passes: {e}")
    print(traceback.format_exc())
# ---------- end rpengrave ----------
rpdogbone = RhinoPathsDogbone()  # -> dogboned
#   port boundary: Outer boundary curve
#   port tool_diam: Tool diameter, mm
#   port climb: True: climb milling, False: conventional
#   port dogboned: Boundary with dogbones inserted
# ---------- rpdogbone: Python ----------
import sys as _sys, os as _os
_SRC = _os.path.normpath(_os.path.expanduser("~/antigravity/scratch/opencam-rhino8/src"))
if _os.path.exists(_SRC) and _SRC not in _sys.path:
    _sys.path.insert(0, _SRC)

_RHINO_SITE = _os.path.expanduser("~/.rhinocode/py39-rh8/lib/python3.9/site-packages")
if _os.path.exists(_RHINO_SITE) and _RHINO_SITE not in _sys.path:
    _sys.path.insert(0, _RHINO_SITE)

import traceback
from rhinopaths.geometry import curve_to_polyline, polyline_to_curve
from rhinopaths.dogbone import add_dogbones

if tool_diam is None: tool_diam = 6.0
if climb is None: climb = True

dogboned = boundary

try:
    if boundary:
        tol = 0.01
        pts = curve_to_polyline(boundary, tol)
        
        path_2d = add_dogbones(pts, tool_diam, climb)
        if path_2d:
            dogboned = polyline_to_curve(path_2d)

except Exception as e:
    print(f"Error computing dogbones: {e}")
    print(traceback.format_exc())
# ---------- end rpdogbone ----------
rpfeed = RhinoPathsFeedrate()  # -> feed_mm_min
#   port tool_diam: Tool diameter, mm
#   port flutes: Number of cutter flutes
#   port chipload: Target chipload mm/tooth
#   port feed_mm_min: Calculated feedrate in mm/min
# ---------- rpfeed: Python ----------
import sys as _sys, os as _os
_SRC = _os.path.normpath(_os.path.expanduser("~/antigravity/scratch/opencam-rhino8/src"))
if _os.path.exists(_SRC) and _SRC not in _sys.path:
    _sys.path.insert(0, _SRC)

_RHINO_SITE = _os.path.expanduser("~/.rhinocode/py39-rh8/lib/python3.9/site-packages")
if _os.path.exists(_RHINO_SITE) and _RHINO_SITE not in _sys.path:
    _sys.path.insert(0, _RHINO_SITE)

import traceback
from rhinopaths.feedrate import feedrate

if tool_diam is None: tool_diam = 6.0
if flutes is None: flutes = 2
if rpm is None: rpm = 18000
if chipload is None: chipload = 0.05

feed_mm_min = None

try:
    feed_mm_min = feedrate(tool_diam, flutes, rpm, chipload)
except Exception as e:
    print(f"Error calculating feedrate: {e}")
    print(traceback.format_exc())
# ---------- end rpfeed ----------
rppost = RhinoPathsPostProcessor()  # -> file_content; inputs cut_passes: list, drill_pts: list
#   port cut_passes: Nested list of cut curves (e.g., from Cutout/Pocket)
#   port drill_pts: List of drill centres (e.g., from Drill)
#   port machine: 'gcode' or 'shopbot'
#   port safe_z: Rapid retract height, mm
#   port ramp_dist: Helical ramp entry length, mm
#   port tabs: Insert tabs automatically
#   port feedrate: Cutting feedrate, mm/min
#   port plunge: Plunge speed, mm/min
#   port file_content: Generated G-code / SBP text
# ---------- rppost: Python ----------
import sys as _sys, os as _os
_SRC = _os.path.normpath(_os.path.expanduser("~/antigravity/scratch/opencam-rhino8/src"))
if _os.path.exists(_SRC) and _SRC not in _sys.path:
    _sys.path.insert(0, _SRC)

_RHINO_SITE = _os.path.expanduser("~/.rhinocode/py39-rh8/lib/python3.9/site-packages")
if _os.path.exists(_RHINO_SITE) and _RHINO_SITE not in _sys.path:
    _sys.path.insert(0, _RHINO_SITE)

import traceback
from rhinopaths.geometry import curve_to_polyline
from rhinopaths.postprocessor import GCodePost, ShopBotPost

if machine is None: machine = "gcode"
if safe_z is None: safe_z = 20.0
if ramp_dist is None: ramp_dist = 0.0
if tabs is None: tabs = False
if feedrate is None: feedrate = 2000.0
if plunge is None: plunge = 800.0

file_content = ""

try:
    post_cls = ShopBotPost if str(machine).lower() == "shopbot" else GCodePost
    post = post_cls(safe_z=safe_z, feedrate=feedrate, plunge_speed=plunge)
    
    post.header()
    
    # Process cutting passes
    if cut_passes:
        tol = 0.01
        for pass_group in cut_passes:
            if not pass_group: continue
            
            # Unpack branches if data trees are passed in
            if hasattr(pass_group, 'BranchCount'):
                path_list = [crv for i in range(pass_group.BranchCount) for crv in pass_group.Branch(i)]
            elif isinstance(pass_group, (list, tuple)):
                path_list = pass_group
            else:
                path_list = [pass_group]
                
            for crv in path_list:
                pts = curve_to_polyline(crv, tol)
                if not pts: continue
                
                # Check tabs/ramps
                z_start = pts[0][2] if len(pts[0]) > 2 else 0.0
                if ramp_dist > 0:
                    pts = post.ramp_entry(pts, ramp_dist)
                
                if tabs:
                    pts = post.tabs(pts, z_lift=5.0, current_z=z_start)

                post.toolpath(pts)
    
    # Process drills
    if drill_pts:
        pts = [(p.X, p.Y, p.Z) for p in drill_pts]
        post.drill_points(pts)

    post.footer()
    file_content = post.get_code()

except Exception as e:
    print(f"Error generating code: {e}")
    print(traceback.format_exc())
# ---------- end rppost ----------
rppreview = RhinoPathsGCodePreview()  # -> rapid_moves, feed_moves
#   port gcode_text: The raw G-code text to preview
#   port rapid_moves: Red rapid/travel moves (G0)
#   port feed_moves: Blue cutting moves (G1/G2/G3)
# ---------- rppreview: Python ----------
import sys as _sys, os as _os
_SRC = _os.path.normpath(_os.path.expanduser("~/antigravity/scratch/opencam-rhino8/src"))
if _os.path.exists(_SRC) and _SRC not in _sys.path:
    _sys.path.insert(0, _SRC)

_RHINO_SITE = _os.path.expanduser("~/.rhinocode/py39-rh8/lib/python3.9/site-packages")
if _os.path.exists(_RHINO_SITE) and _RHINO_SITE not in _sys.path:
    _sys.path.insert(0, _RHINO_SITE)

import traceback
import Rhino.Geometry as rg

rapid_moves = []
feed_moves = []

try:
    if gcode_text:
        lines = str(gcode_text).split("\n")
        
        last_pt = rg.Point3d(0, 0, 0)
        mode = "G0"
        
        for line in lines:
            line = line.split(";")[0].strip().upper()
            if not line: continue
            
            if "G0" in line: mode = "G0"
            elif "G1" in line: mode = "G1"
            
            x, y, z = last_pt.X, last_pt.Y, last_pt.Z
            has_move = False
            
            for part in line.split():
                if part.startswith("X"):
                    x = float(part[1:])
                    has_move = True
                elif part.startswith("Y"):
                    y = float(part[1:])
                    has_move = True
                elif part.startswith("Z"):
                    z = float(part[1:])
                    has_move = True
                    
            if has_move:
                next_pt = rg.Point3d(x, y, z)
                line_crv = rg.LineCurve(last_pt, next_pt)
                
                if mode == "G0":
                    rapid_moves.append(line_crv)
                else:
                    feed_moves.append(line_crv)
                    
                last_pt = next_pt

except Exception as e:
    print(f"Error previewing code: {e}")
    print(traceback.format_exc())
# ---------- end rppreview ----------
rpzdepths = RhinoPathsPassDepths()  # -> depths
#   port start_z: Top of material, mm
#   port end_z: Target cutting depth, mm (negative)
#   port pass_depth: Max step-down per pass, mm
#   port depths: Calculated Z depths from start_z to end_z
# ---------- rpzdepths: Python ----------
import sys as _sys, os as _os
_SRC = _os.path.normpath(_os.path.expanduser("~/antigravity/scratch/opencam-rhino8/src"))
if _os.path.exists(_SRC) and _SRC not in _sys.path:
    _sys.path.insert(0, _SRC)

_RHINO_SITE = _os.path.expanduser("~/.rhinocode/py39-rh8/lib/python3.9/site-packages")
if _os.path.exists(_RHINO_SITE) and _RHINO_SITE not in _sys.path:
    _sys.path.insert(0, _RHINO_SITE)

import traceback
from rhinopaths.toolpaths import pass_depths as calc_depths

if start_z is None: start_z = 0.0
if end_z is None: end_z = -18.0
if pass_depth is None: pass_depth = 6.0

depths = []

try:
    depths = calc_depths(start_z, end_z, pass_depth)
except Exception as e:
    print(f"Error calculating pass depths: {e}")
    print(traceback.format_exc())
# ---------- end rpzdepths ----------
